# Grasshopper definition Test.gh (Grasshopper 1.0.7)

cluster = AB_4()
cluster_2 = AB_3()
cluster_3 = AB_2()
cluster_4 = AB()

# ==== cluster AB
num = ClusterInput()
num_2 = ClusterInput()
num_3 = Number(num)
num_4 = Number(num_2)
addition = Addition(A=num_3, B=num_4)
num_5 = Number(addition)
num_6 = ClusterOutput(num_5)

# ==== cluster AB_2
num = ClusterInput()
num_2 = ClusterInput()
num_3 = Number(num)
num_4 = Number(num_2)
subtraction = Subtraction(A=num_3, B=num_4)
num_5 = Number(subtraction)
num_6 = ClusterOutput(num_5)

# ==== cluster AB_3
num = ClusterInput()
num_2 = ClusterInput()
num_3 = Number(num)
num_4 = Number(num_2)
multiplication = Multiplication(A=num_3, B=num_4)
num_5 = Number(multiplication)
num_6 = ClusterOutput(num_5)

# ==== cluster AB_4
num = ClusterInput()
num_2 = ClusterInput()
num_3 = Number(num)
num_4 = Number(num_2)
division = Division(A=num_3, B=num_4)
num_5 = Number(division)
num_6 = ClusterOutput(num_5)
